# Grasshopper definition dreamhopper-swiftlet.gh (Grasshopper 1.0.7)
# plug-ins: Swiftlet

# ----
# INPUTS
iterations = Slider(15000, range=0..20000)
wh = Slider(160, range=0..1000)
seed = Slider(-1, range=-1000..1000)
wh_2 = Slider(160, range=0..1000)
prompt = Panel("an organic biological pavilion could breath with building skin growing moss by Zaha Hadid, cgsociety, surreal, 8K HD")
int = Integer(wh_2)
int_2 = Integer(wh)
merge = Merge(
    Data1=flatten(prompt),
    Data2=flatten(iterations),
    Data3=flatten(seed),
    Data4=flatten(int),
    Data5=flatten(int),
    Data6=flatten(int_2),
    Data7=flatten(int_2))

# ----
# ENDPOINT
base_url = Panel("https://6286-38-104-71-142.ngrok.io/")
concat = Concatenate(FragmentA=base_url, FragmentB="generate")
concat_2 = Concatenate(FragmentA=base_url, FragmentB="check")
panel = Panel(concat)
panel_2 = Panel(concat_2)

dam = DataDam(DataA=merge, BufferDelay=10000000, BufferMode=0)

# ----
# GENERATE MESH REQUEST
keys = Panel("""text
iters
seed
w
h
W
H""")
cjv = CreateJSONValue(Value=dam)
cjo = CreateJSONObject(Keys=keys, Values=cjv)
ctb = CreateTextBody(Content=cjo, IsHtmlChecked=False, IsJavascriptChecked=False, IsJsonChecked=True, IsTextChecked=False, IsXmlChecked=False)
post = POSTRequest(URL=panel, Body=ctb)  # -> Status, Content, Response
pjs = ParseJSONString(Text=post.Content)
gjok = GetJSONObjectKey(JObject=pjs, Key="id")
rjv = ReadJSONValue(JValue=gjok)  # -> AsString, AsNumber, AsBool
request_id = Panel(rjv.AsString)

# ----
# CHECK IF DONE
trigger = Trigger(Interval=5000, TimerInterval=5000, Target=post_2)  # disabled
dam_2 = DataDam(DataA=request_id, BufferDelay=10000000, BufferMode=0)
cjv_2 = CreateJSONValue(Value=dam_2)
cjo_2 = CreateJSONObject(Keys="id", Values=cjv_2)
ctb_2 = CreateTextBody(
    Content=cjo_2,
    IsHtmlChecked=False,
    IsJavascriptChecked=False,
    IsJsonChecked=True,
    IsTextChecked=False,
    IsXmlChecked=False)
post_2 = POSTRequest(URL=panel_2, Body=ctb_2)  # -> Status, Content, Response
pjs_2 = ParseJSONString(Text=post_2.Content)
gjok_2 = GetJSONObjectKey(JObject=pjs_2, Key="done")
rjv_2 = ReadJSONValue(JValue=gjok_2)  # -> AsString, AsNumber, AsBool
rec = DataRecorder(rjv_2.AsBool, DataLimit=-10, RecordData=True)
is_done = Panel(rec)

# ----
# CONSTRUCT MESH
# VERTICES
# FACES
panel_3 = Panel("vertices")
gjok_3 = GetJSONObjectKey(JObject=pjs_2, Key="mesh")
dam_3 = DataDam(DataA=gjok_3, BufferDelay=10000000, BufferMode=0)
gjok_4 = GetJSONObjectKey(JObject=dam_3, Key="faces")
gjok_5 = GetJSONObjectKey(JObject=dam_3, Key=panel_3)
rja = ReadJSONArray(Array=gjok_5)
rja_2 = ReadJSONArray(Array=gjok_4)
rja_3 = ReadJSONArray(Array=rja_2)  # -> simplify(JTokens)
rja_4 = ReadJSONArray(Array=rja)  # -> simplify(JTokens)
rjv_3 = ReadJSONValue(JValue=rja_4)  # -> AsString, AsNumber, AsBool
rjv_4 = ReadJSONValue(JValue=rja_3)  # -> AsString, AsNumber, AsBool
item = ListItem(List=rjv_3.AsNumber, Index=0, Wrap=True)  # -> Item, Item1, Item2, Item3, Item4, Item5
dom = ConstructDomain(DomainStart=0, DomainEnd=255)
int_3 = Integer(rjv_4.AsNumber)
item_2 = ListItem(List=int_3, Index=0, Wrap=True)  # -> Item, Item1, Item2
triangle = MeshTriangle(CornerA=item_2.Item, CornerB=item_2.Item1, CornerC=item_2.Item2)  # -> flatten(Face)

# ---- group: Y
num = Number(item.Item1)

# ---- group: Z
num_2 = Number(item.Item2)

# ---- group: X
num_3 = Number(item.Item)

# ---- group: G
num_4 = Number(item.Item4)

# ---- group: R
num_5 = Number(item.Item3)

# ---- group: B
num_6 = Number(item.Item5)

# ----
pt = ConstructPoint(XCoordinate=num_3, YCoordinate=num, ZCoordinate=num_2)  # -> flatten(Point)
remap = RemapNumbers(Value=num_5, Source=Domain(0, 1), Target=dom)  # -> Mapped, Clipped
remap_2 = RemapNumbers(Value=num_4, Source=Domain(0, 1), Target=dom)  # -> Mapped, Clipped
remap_3 = RemapNumbers(Value=num_6, Source=Domain(0, 1), Target=dom)  # -> Mapped, Clipped
rgb = ColourRGB(Alpha=255, Red=remap.Mapped, Green=remap_2.Mapped, Blue=remap_3.Mapped)  # -> flatten(Colour)
conmesh = ConstructMesh(Vertices=pt, Faces=triangle)
mcol = MeshColours(Mesh=conmesh, Colours=rgb)

bbox = BoundingBox(Content=mcol, Plane=PlaneXY(0, 0, 0))  # -> Box, Box_2
debox = DeconstructBox(Box=bbox.Box)  # -> Plane, X, Y, Z
num_7 = Number(debox.Z)
division = Division(A=num_7, B="2")
Z = UnitZ(Factor=division)
move = Move(Geometry=mcol, Motion=Z)  # -> Geometry, Transform

# ---- group: PREVIEW MESH
mesh = Mesh(move.Geometry)
